# Grasshopper definition Assignment 01.gh (Grasshopper 1.0.7)
# plug-ins: Hops

pt = Point(Point(6.234803158, 0.7304177657, 0))
pt_2 = Point(Point(6.234803158, 6.390747373, 0))
pt_3 = Point(Point(0, 0, 0))
pt_4 = Point(Point(0, 6.390747373, 0))
concat = Concatenate(FragmentA="http://127.0.0.1:5000", FragmentB="/createGraph")
concat_2 = Concatenate(FragmentA="http://127.0.0.1:5000", FragmentB="/createGraph")
concat_3 = Concatenate(FragmentA="http://127.0.0.1:5000", FragmentB="/extrudeCurve")
intcrv = Interpolate(Vertices=[pt_3, pt_4, pt_2, pt], Degree=3, Periodic=False, KnotStyle=1)  # -> Curve, Length, Domain
panel = Panel(concat_3)
hops = Hops(
    _Path=concat_3,
    Curve=intcrv.Curve,
    Height=Slider(10, range=1..10),
    CacheResultsInMemory=True,
    CacheSolveResults=True,
    RemoteDefinitionLocation="http://127.0.0.1:5000/extrudeCurve",
    RemoteSolveVersion=(0, 1, 0),
    ShowInput_Enabled=False,
    ShowInput_Path=True,
    SynchronousSolve=True)
